# Grasshopper definition bolt holder voronoi mesh.gh (Grasshopper 1.0.7)
# plug-ins: Kangaroo2 Components

columns = Slider(2, range=0..10)
series = Series(Start=0, Step=1, Count=columns)

# ---- group: Screw points
y_spacing = Slider(150, range=0..300)
rows = Slider(3, range=0..10)
x_spacing = Slider(50, range=0..1000)
pt = ConstructPoint(XCoordinate=0, YCoordinate=0, ZCoordinate=0)
series_2 = Series(Start=0, Step=1, Count=rows)
multiplication = Multiplication(A=y_spacing, B=series_2)
Y = UnitY(Factor=multiplication)

# ----
multiplication_2 = Multiplication(A=x_spacing, B=series)

# ---- group: Screw points (continued)
X = UnitX(Factor=multiplication_2)
move = Move(Geometry=pt, Motion=X)  # -> Geometry, Transform
move_2 = Move(Geometry=graft(move.Geometry), Motion=Y)  # -> flatten(Geometry), Transform

# ---- group: Bounding rectangle
bnd = Bounds2D(Coordinates=move_2.Geometry)
dedom2num = DeconstructDomain²(Domain=bnd)  # -> UMin, UMax, VMin, VMax
pt_2 = ConstructPoint(XCoordinate=dedom2num.UMin, YCoordinate=dedom2num.VMin, ZCoordinate=0)
pt_3 = ConstructPoint(XCoordinate=dedom2num.UMax, YCoordinate=dedom2num.VMax, ZCoordinate=0)
rec_2pt = Rectangle2Pt(Plane=PlaneXY(0, 0, 0), PointA=pt_2, PointB=pt_3, Radius=0)  # -> Rectangle, Length

# ---- group: Voronoi
pcen = PolygonCenter(Polyline=rec_2pt.Rectangle)  # -> CenterV, CenterE, CenterA
scale = Scale(Geometry=rec_2pt.Rectangle, Center=pcen.CenterV, Factor=Slider(1.2, range=0..1.5))  # -> Geometry, Transform
pop2d = Populate2D(Region=scale.Geometry, Count=Slider(69, range=1..100), Seed=Slider(3, range=1..10))
voronoi = Voronoi(Points=flatten([pop2d, move_2.Geometry]), BruteForceOverride=False)

# ---- group: Nuts
bottom_thickness = Slider(0.6, range=0..1)  # disabled
nut_size = Slider(5.6, range=0..10)  # disabled
number_slider = Slider(10, range=0..10)  # disabled
polygon = Polygon(Plane=move_2.Geometry, Radius=expr("x/2", nut_size), Segments=6, FilletRadius=0)  # -> Polygon, Length; disabled
srf = Surface(polygon.Polygon)  # disabled
Z = UnitZ(Factor=number_slider)  # disabled
extr = Extrude(Base=srf, Direction=Z)  # disabled
Z_2 = UnitZ(Factor=bottom_thickness)  # disabled
move_3 = Move(Geometry=extr, Motion=Z_2)  # -> Geometry, Transform; disabled

# ---- group: Screw holes
nut_height = Slider(7, range=0..10)
support_outer_diam = Slider(11, range=0..20)
screw_diameter = Slider(4.5, range=0..10)
addition = Addition(A=nut_height, B=bottom_thickness)
cyl = Cylinder(Base=move_2.Geometry, Radius=expr("x/2", screw_diameter), Length=addition)
cyl_2 = Cylinder(Base=move_2.Geometry, Radius=expr("x/2", support_outer_diam), Length=addition)
cap = CapHoles(Brep=cyl_2)
cap_2 = CapHoles(Brep=cyl)

# ---- group: heat set cutouts
heat_set_diameter = Slider(5.6, range=0..10)
cut_height = Slider(10, range=0..10)
bottom_offset = Slider(0.6, range=0..1)
circle = CircleCNR(Center=move_2.Geometry, Normal=Vector(0, 0, 1), Radius=expr("x/2", heat_set_diameter))
Z_3 = UnitZ(Factor=cut_height)
srf_2 = Surface(circle)
extr_2 = Extrude(Base=srf_2, Direction=Z_3)
Z_4 = UnitZ(Factor=bottom_offset)
move_4 = Move(Geometry=extr_2, Motion=Z_4)  # -> Geometry, Transform

# ---- group: Cells inside boundary
scale_nu = ScaleNU(Geometry=rec_2pt.Rectangle, Plane=pcen.CenterV, ScaleX=Slider(1.2, range=0..10), ScaleY=Slider(1, range=0..10), ScaleZ=1)  # -> Geometry, Transform
trim = TrimWithRegion(Curve=voronoi, Region=scale_nu.Geometry)  # -> Inside, Outside
cls = Closed(Curve=trim.Inside)  # -> Closed, Periodic
dispatch = Dispatch(List=trim.Inside, DispatchPattern=cls.Closed)  # -> ListA, ListB
crv = Curve(dispatch.ListA)

# ---- group: Dedupe segments
explode = Explode(Curve=crv, Recursive=True)  # -> flatten(Segments), Vertices
midpt = CurveMiddle(Curve=explode.Segments)
cullpt = CullDuplicates(Points=midpt, Tolerance=0.1, CullMode=1)  # -> Points, Indices, Valence
item = ListItem(List=explode.Segments, Index=cullpt.Indices, Wrap=True)
crv_2 = Curve(item)

# ---- group: Points
end = EndPoints(Curve=crv_2)  # -> Start, End
pt_4 = Point([end.Start, end.End])
duppt = RemoveDuplicatePts(Points=flatten(pt_4), Tolerance=0.01)

# ---- group: Anchor to screw holes
cps = ClosestPoints(Point=move_2.Geometry, Cloud=duppt, Count=Slider(1, range=0..10))  # -> simplify(flatten(ClosestPoint)), CPIndex, Distance
pt_5 = Point(move_2.Geometry)
anchor = Anchor(Point=cps.ClosestPoint, Target=pt_5, Strength="10000")

# ---- group: Keep points inside bounds
srf_3 = Surface(scale_nu.Geometry)
mesh_uv = MeshSurface(Surface=srf_3, UCount=5, VCount=5, Overhang=True, Equalize=False)
onmesh = OnMesh(Points=duppt, Mesh=mesh_uv, Strength=Slider(100, range=0..100))

# ---- group: Prevent points intersecting
number_slider_2 = Slider(8, range=0..50)
sc = SphereCollide(Points=duppt, Radius=number_slider_2, Strength=Slider(50, range=0..100))

# ---- group: Cell goals
length_line = LengthLine(Line=flatten(crv_2), Length=Slider(0.01, range=0..1), Strength=10)
show = Show(G=flatten(crv_2))

# ---- group: anchor points to plane
anchorxyz = AnchorXYZ(Point=duppt, X=False, Y=False, Z=Toggle(True), Strength="10000")

# ---- group: Solver
merge = Merge(Data1=show, Data2=length_line, Data3=anchor, Data4=sc, Data5=anchorxyz, Data6=onmesh)  # -> flatten(Result)
zombiesolver = ZombieSolver(GoalObjects=merge, Threshold=1e-10, Tolerance=0.0001, MaxIterations=50000)  # -> I, V, O
bouncysolver = BouncySolver(GoalObjects=merge, Reset=Button(), Threshold=1e-15, Tolerance=0.0001, Damping=0.99, Iterations=10, On=Toggle(False))  # -> I, V, O

# ---- group: clean and remove dupes
clean = CleanTree(RemoveNulls=True, RemoveInvalid=True, RemoveEmpty=True, Tree=bouncysolver.O)
explode_2 = Explode(Curve=clean, Recursive=True)  # -> flatten(Segments), Vertices
midpt_2 = CurveMiddle(Curve=explode_2.Segments)
cullpt_2 = CullDuplicates(Points=midpt_2, Tolerance=0.1, CullMode=1)  # -> Points, Indices, Valence
item_2 = ListItem(List=explode_2.Segments, Index=cullpt_2.Indices, Wrap=True)
crv_3 = Curve(item_2)

# ---- group: Fatten pipe around screws
end_2 = EndPoints(Curve=crv_3)  # -> Start, End
pt_6 = Point([end_2.Start, end_2.End])
duppt_2 = RemoveDuplicatePts(Points=pt_6, Tolerance=0.01)
lng = ListLength(List=duppt_2)
cp = ClosestPoint(Point=move_2.Geometry, Cloud=duppt_2)  # -> ClosestPoint, CPIndex, Distance
dup = DuplicateData(Data=Slider(3, range=0..10), Number=lng, Order=True)
replace = ReplaceItems(List=dup, Item=Slider(6, range=0..10), Indices=cp.CPIndex, Wrap=False)

# ----
sph = Sphere(Base=pt_6, Radius=number_slider_2)

number_slider_3 = Slider(3, range=0..10)
mp = MultiPipe(
    Curves=crv_3,
    NodeSize=replace,
    SizePoints=duppt_2,
    EndOffset=Slider(2, range=0..100),
    StrutSize=Slider(0.8, range=0..1),
    Segment=0,
    KinkAngle=Slider(0.6, range=0..1),
    CubeFit=Slider(1, range=0..1),
    Caps=Slider(2, range=0..2))

# ---- group: Slice ground plane
number_slider_4 = Slider(-29, range=-100..100)
Y_2 = UnitY(Factor=number_slider_4)
scale_2 = Scale(Geometry=rec_2pt.Rectangle, Center=Point(0, 0, 0), Factor=Slider(2, range=0..10))  # -> Geometry, Transform
X_2 = UnitX(Factor=number_slider_4)
addition_2 = Addition(A=Y_2, B=X_2)
move_5 = Move(Geometry=scale_2.Geometry, Motion=addition_2)  # -> Geometry, Transform
boxrec = BoxRectangle(Rectangle=move_5.Geometry, Height="-20")
sdiff = SolidDifference(BrepsA=mp, BrepsB=boxrec)

# ----
sunion = SolidUnion(Breps=flatten([cap, sdiff]))
sdiff_2 = SolidDifference(BrepsA=sunion, BrepsB=cap_2)
sdiff_3 = SolidDifference(BrepsA=sdiff_2, BrepsB=move_4.Geometry)
